# Grasshopper definition export_to_json.gh (Grasshopper 1.0.8)

path = FilePath("C:\Users\dsuk.TSGARCH\OneDrive - Steinberg Hart\Desktop\Source\RhinoScripts\src\excel\my_definition.json")
panel = Panel(path)
export_to_json = ExportToJSON()  # -> out, a
# ---------- export_to_json: Python ----------
"""CPython Script Component: Export GH Definition to JSON
Exports the current Grasshopper definition to a structured JSON file for analysis

Inputs:
    out_path: str (e.g. r"C:\...\my_def.json")

Outputs:
    a: string  # Status message
"""
import json
import rhinoscriptsyntax as rs
import Rhino
import Grasshopper as gh
import scriptcontext as sc

# Get the active Grasshopper document
doc = sc.doc

if not hasattr(sc, 'sticky') or 'GrasshopperDocument' not in sc.sticky:
    # Try to get from component
    try:
        doc = ghenv.Component.OnPingDocument()
    except:
        a = "ERROR: Could not access Grasshopper document"
        raise Exception(a)
else:
    doc = sc.sticky['GrasshopperDocument']

# Get document properties safely
doc_title = ""
doc_path = ""
gh_version = ""

try:
    if hasattr(doc, 'Properties') and doc.Properties:
        doc_title = str(doc.Properties.Description) if hasattr(doc.Properties, 'Description') else ""
except:
    pass

try:
    if hasattr(doc, 'FilePath') and doc.FilePath:
        doc_path = str(doc.FilePath)
except:
    pass

try:
    gh_version = str(gh.Folders.GrasshopperVersion)
except:
    pass

data = {
    "document": {
        "title": doc_title,
        "path": doc_path,
        "gh_version": gh_version
    },
    "components": [],
    "params": [],
    "wires": [],
    "warnings": []
}

def pt_to_xy(pt):
    try:
        return [float(pt.X), float(pt.Y)]
    except:
        return [0.0, 0.0]

for obj in doc.Objects:
    try:
        dobj = {
            "guid": str(obj.InstanceGuid),
            "name": str(obj.NickName or obj.Name or obj.Description),
            "type": str(obj.GetType().FullName),
            "category": str(getattr(obj, "Category", "")),
            "subcategory": str(getattr(obj, "SubCategory", "")),
            "pos": pt_to_xy(obj.Attributes.Pivot),
            "group": str(obj.Attributes.GetTopLevelContainer().InstanceGuid) if (obj.Attributes and obj.Attributes.GetTopLevelContainer()) else None
        }
        
        # Check if component
        if isinstance(obj, gh.Kernel.IGH_Component):
            ins = []
            for i, ip in enumerate(obj.Params.Input):
                param_info = {
                    "index": i,
                    "name": str(ip.NickName or ip.Name),
                    "tree_access": str(ip.Access)
                }
                if hasattr(ip, "TypeHint"):
                    param_info["type_hint"] = str(ip.TypeHint)
                ins.append(param_info)
            
            outs = []
            for i, op in enumerate(obj.Params.Output):
                outs.append({
                    "index": i,
                    "name": str(op.NickName or op.Name),
                    "tree_access": str(op.Access)
                })
            
            dobj["inputs"] = ins
            dobj["outputs"] = outs
            data["components"].append(dobj)
        else:
            # Parameter objects
            dobj["param_kind"] = str(obj.GetType().Name)
            
            # Slider values
            try:
                from Grasshopper.Kernel.Special import GH_NumberSlider, GH_Panel
                if isinstance(obj, GH_NumberSlider):
                    dobj["slider"] = {
                        "value": float(obj.CurrentValue),
                        "min": float(obj.Slider.Minimum),
                        "max": float(obj.Slider.Maximum),
                        "rounding": int(obj.Slider.Rounding)
                    }
                elif isinstance(obj, GH_Panel):
                    dobj["panel_text"] = str(obj.UserText)
            except:
                pass
            
            data["params"].append(dobj)
        
        # Collect wires
        if isinstance(obj, gh.Kernel.IGH_Component):
            for oi, op in enumerate(obj.Params.Output):
                for rec in op.Recipients:
                    try:
                        tgt_parent = None
                        try:
                            tgt_parent = rec.Attributes.GetTopLevel.DocObject
                        except:
                            if rec.Attributes and rec.Attributes.Parent:
                                tgt_parent = rec.Attributes.Parent.DocObject
                        
                        wire_info = {
                            "from": {
                                "guid": str(obj.InstanceGuid),
                                "out_index": oi,
                                "out_name": str(op.NickName or op.Name)
                            },
                            "to": {
                                "guid": str(tgt_parent.InstanceGuid) if tgt_parent else "",
                                "in_name": str(rec.NickName or rec.Name)
                            }
                        }
                        data["wires"].append(wire_info)
                    except Exception as wire_e:
                        data["warnings"].append(f"wire_error: {wire_e}")
    
    except Exception as e:
        data["warnings"].append(f"scan_error: {obj} -> {e}")

# Plugin summary
try:
    plugins = sorted(list(set([(c.get("category", ""), c.get("subcategory", ""))
                               for c in data["components"]])))
    data["plugins"] = [{"category": c, "subcategory": s} for (c, s) in plugins]
except:
    data["plugins"] = []

# Stats
data["stats"] = {
    "total_components": len(data["components"]),
    "total_params": len(data["params"]),
    "total_wires": len(data["wires"]),
    "warnings_count": len(data["warnings"])
}

# Write JSON
try:
    with open(out_path, "w", encoding="utf-8") as f:
        json.dump(data, f, ensure_ascii=False, indent=2)
    
    a = f"✓ Exported to: {out_path}\n{data['stats']['total_components']} components, {data['stats']['total_params']} params, {data['stats']['total_wires']} wires"
except Exception as write_e:
    a = f"ERROR: Failed to write file - {write_e}"
# ---------- end export_to_json ----------
